# Grasshopper definition export_fixture.gh (Grasshopper 1.0.8)

S = Script()  # -> folder_path
# ---------- S: Python ----------
import sys
import os

ghComp = ghenv.Component
ghDoc = ghComp.OnPingDocument()

# the full path of the gh file
current_path = ghDoc.FilePath
# the current directory 
folder_path = os.path.abspath(os.path.join(current_path,"..","..","..","benchmarks","fixtures"))
# ---------- end S ----------
pop2d = Populate2D(
    Region={Plane=PlaneXY(0, 0, 0), Size=Domain2(u=0..20, v=0..10)},
    Count=Slider(1000, range=0..1000),
    Seed=Slider(5, range=0..10))
panel = Panel(S)
path = FilePath("D:\00_Fen\00_github\geomseq\benchmarks\fixtures\")
toggle = BooleanToggle(False)
geo = Geometry(pop2d)
list = ValueList({"points", "curves"}, selected="points")
path_2 = FilePath("D:\00_Fen\00_github\geomseq\benchmarks\fixtures\")
panel_2 = Panel(path)
number_slider = Slider(1, range=1..10)
number_slider_2 = Slider(1000, range=1..10000)
export_fixture = Python3Script(geo=geo, kind=list, file_name="Hello_fixture", save_dir=path_2, save_json=Button())  # -> out; inputs geo: list, kind: String, file_name: String, save_dir: String, save_json: Boolean
# ---------- export_fixture: Python ----------
"""GH entry point: dump selected geometry to a benchmark fixture JSON.

Tooling, not part of the shipped library -- it touches no geomseq_core code,
only Rhino and json. Format and wanted datasets: docs/benchmark-fixtures.md

Inputs   save_json (bool)  write on True; leave False while wiring things up
         geo       (list)  Point3d when kind="points", Curve when kind="curves".
                           Set the GH input to List Access and NO type hint, so
                           one component can do both.
         kind      (str)   "points" or "curves" -- also the filename prefix the
                           harness globs for
         file_name (str)   label for this dataset, e.g. "real_lettering"
         save_dir  (str)   existing directory, e.g. ...\\benchmarks\\fixtures
Outputs  path, log

Do not name an input `dir`, `type`, `id` or any other builtin: an unconnected
input is simply not injected, so the name quietly resolves to the builtin
instead of raising NameError, and the failure surfaces somewhere confusing.

IMPORTANT: feed the geometry in its ORIGINAL, UNSORTED order. Exporting the
output of a previous sort makes the benchmark measure sorting an already-sorted
input -- greedy has nothing to do and 2-opt converges early, so the numbers come
out flattering and meaningless.

Only curve endpoints are recorded, which is all sort_curves itself reads.
"""

import json
import os
import re

KINDS = ("points", "curves")   # what benchmarks/python/cases.py knows how to load
PRECISION = 4                  # decimals; 1e-4 mm is well past any CAD tolerance
Z_TOLERANCE = 1e-9             # above this, Z is real data and dropping it matters


def slugify(text):
    """'Real Lettering v2' -> 'real_lettering_v2'; becomes the data column label."""
    return re.sub(r"[^a-z0-9]+", "_", (text or "").lower()).strip("_")


def point_row(p):
    return [round(p.X, PRECISION), round(p.Y, PRECISION)]


def curve_row(c):
    s, e = c.PointAtStart, c.PointAtEnd
    return [round(s.X, PRECISION), round(s.Y, PRECISION),
            round(e.X, PRECISION), round(e.Y, PRECISION)]


def z_values(kind, items):
    if kind == "points":
        return [abs(p.Z) for p in items]
    return [z for c in items for z in (abs(c.PointAtStart.Z), abs(c.PointAtEnd.Z))]


if __name__ == "__main__":
    log = []
    path = None

    label = slugify(file_name)                      # type: ignore # noqa: F821
    # A file_name of "points_foo" would otherwise become points_points_foo.json.
    for k in KINDS:
        if label.startswith(k + "_"):
            label = label[len(k) + 1:]

    if not save_json:                               # type: ignore # noqa: F821
        log.append("save_json is False -- nothing written.")
    elif not geo:                                   # type: ignore # noqa: F821
        log.append("no geometry supplied.")
    elif kind not in KINDS:                         # type: ignore # noqa: F821
        log.append("kind must be one of %s, got %r -- the harness globs on that "
                   "prefix and would not find the file." % (KINDS, kind))  # type: ignore # noqa: F821
    elif not label:
        log.append("file_name is empty (or slugifies to nothing).")
    elif not isinstance(save_dir, str) or not os.path.isdir(save_dir):  # type: ignore # noqa: F821
        log.append("save_dir is not an existing directory: %r" % (save_dir,))  # type: ignore # noqa: F821
    else:
        items = list(geo)                           # type: ignore # noqa: F821

        # The fixture format is 2D, but the core does receive Z. If the geometry
        # is off the world XY plane, dropping Z here would make the fixture
        # disagree with what Rhino actually feeds the DLL.
        try:
            max_z = max(z_values(kind, items))      # type: ignore # noqa: F821
        except AttributeError:
            max_z = 0.0
            log.append("WARNING: could not read Z -- does geo match kind=%r?"
                       % (kind,))                   # type: ignore # noqa: F821
        if max_z > Z_TOLERANCE:
            log.append("WARNING: max |Z| is %.6g -- Z is dropped by this format. "
                       "Project to XY first if that matters." % max_z)

        row = point_row if kind == "points" else curve_row   # type: ignore # noqa: F821
        data = [row(g) for g in items]

        payload = {
            "kind": kind,                           # type: ignore # noqa: F821
            "name": label,
            "source": "exported via benchmarks/gh/export_fixture.py",
            "units": "",   # fill in, or read Rhino.RhinoDoc.ActiveDoc.ModelUnitSystem
            "notes": "",   # describe the pattern -- a number is not interpretable without it
            "data": data,
        }

        path = os.path.join(save_dir, "%s_%s.json" % (kind, label))  # type: ignore # noqa: F821
        replaced = os.path.exists(path)

        # Metadata one key per line so the header is scannable; `data` stays on
        # a single line. Indenting it too costs 2.4x the size and 256k lines of
        # coordinates nobody reads (measured at 64k points).
        meta = {k: v for k, v in payload.items() if k != "data"}
        head = json.dumps(meta, indent=2, ensure_ascii=False)[:-2]  # drop "\n}"
        with open(path, "w", encoding="utf-8") as fh:
            fh.write(head + ',\n  "data": '
                     + json.dumps(data, separators=(",", ":")) + "\n}\n")

        log.append("%s %d %s -> %s"
                   % ("REPLACED" if replaced else "wrote", len(data), kind, path))  # type: ignore # noqa: F821
        log.append("fill in 'units' and 'notes'; check the input was unsorted.")

    log = "\n".join(log)
# ---------- end export_fixture ----------
read_fixture = Python3Script(sample_n=number_slider_2, select_ix=Slider(0, range=0..10), folder_path=panel, read_json=toggle)  # -> out, file_path, name, kind, info; inputs sample_n: Int32, select_ix: Int32, folder_path: String, read_json: Boolean
# ---------- read_fixture: Python ----------
"""GH entry point: load a benchmark fixture JSON back into Rhino geometry.

The inverse of export_fixture.py, and the same kind of tooling: it touches no
geomseq_core code, only Rhino and json. Use it to look at what a fixture
actually contains before trusting a number measured on it -- clustering,
extent and existing order are all obvious on screen and invisible in a table.

Inputs   read_json  (bool) load on True; leave False while wiring things up
         file_path  (str)  full path to one fixture, e.g.
                           ...\\benchmarks\\fixtures\\points_grid.json
         sample_n   (int)  optional; 0 or unconnected loads every row. Otherwise
                           draws this many rows the SAME way the harness does,
                           so what you see is what gets benchmarked.
         seed       (int)  optional; matches cases.sample's default of 1
Outputs  geo, kind, count, info, log

`geo` is Point3d for kind="points" and LineCurve for kind="curves", so the
output can go straight into the same components the exporter was fed from.
Z is always 0: the fixture format is 2D and never stored it.

Do not name an input `dir`, `type`, `id`, `file` or any other builtin -- an
unconnected input is simply not injected, so the name quietly resolves to the
builtin instead of raising NameError, and the failure surfaces somewhere
confusing.

Fixture format: benchmarks/README.md ("Adding a fixture").
"""

import json
import os
import random

import Rhino.Geometry as rg

KINDS = ("points", "curves")   # what benchmarks/python/cases.py knows how to load
DEFAULT_SEED = 1               # matches cases.sample


def sample(data, n, seed=DEFAULT_SEED):
    """`n` rows drawn from `data`, seeded, IN THE SOURCE'S OWN ORDER.

    Deliberately identical to sample() in benchmarks/python/cases.py -- if this
    drew differently, the geometry on screen would not be the geometry that was
    timed. Sampling rather than slicing keeps the distribution comparable across
    n; the indices are re-sorted because input order is itself under test, and
    random.sample hands its picks back shuffled.
    """
    if n >= len(data):
        return list(data)
    idx = sorted(random.Random(seed).sample(range(len(data)), n))
    return [data[i] for i in idx]


def point_geo(row):
    return rg.Point3d(row[0], row[1], 0.0)


def curve_geo(row):
    return rg.LineCurve(rg.Point3d(row[0], row[1], 0.0),
                        rg.Point3d(row[2], row[3], 0.0))


def describe(doc, path):
    """The provenance header, which is the point of filling it in on export."""
    lines = ["file: %s" % os.path.basename(path)]
    for key in ("kind", "name", "source", "units", "notes"):
        value = doc.get(key)
        if value:
            lines.append("%s: %s" % (key, value))
    params = doc.get("params")
    if params:
        lines.append("params: %s" % json.dumps(params, sort_keys=True))
    lines.append("rows in file: %d" % len(doc.get("data") or []))
    return "\n".join(lines)


if __name__ == "__main__":
    log = []
    geo = []
    kind = None
    count = 0
    info = ""

    if not read_json:                               # type: ignore # noqa: F821
        log.append("read_json is False -- nothing loaded.")
    elif not isinstance(file_path, str) or not os.path.isfile(file_path):  # type: ignore # noqa: F821
        log.append("file_path is not an existing file: %r" % (file_path,))  # type: ignore # noqa: F821
    else:
        with open(file_path, encoding="utf-8") as fh:  # type: ignore # noqa: F821
            doc = json.load(fh)

        kind = doc.get("kind")
        data = doc.get("data") or []
        info = describe(doc, file_path)             # type: ignore # noqa: F821

        # The harness globs on the filename prefix but reads the `kind` field, so
        # a file whose name and field disagree loads as one thing and benchmarks
        # as another. Worth catching here rather than in a timing table.
        prefix = os.path.basename(file_path).split("_", 1)[0]  # type: ignore # noqa: F821
        if kind != prefix:
            log.append("WARNING: kind is %r but the filename says %r -- the "
                       "harness globs on the filename." % (kind, prefix))

        if kind not in KINDS:
            log.append("kind must be one of %s, got %r." % (KINDS, kind))
        elif not data:
            log.append("no rows in 'data'.")
        else:
            wanted = int(sample_n or 0)             # type: ignore # noqa: F821
            if wanted > len(data):
                log.append("sample_n %d exceeds the file's %d rows -- the "
                           "harness SKIPS a sweep size it cannot fill rather "
                           "than truncating, so loading all instead."
                           % (wanted, len(data)))
                wanted = 0
            rows = data if wanted <= 0 else sample(
                data, wanted, int(seed) if seed else DEFAULT_SEED)  # type: ignore # noqa: F821

            build = point_geo if kind == "points" else curve_geo
            try:
                geo = [build(r) for r in rows]
            except (TypeError, IndexError):
                geo = []
                log.append("row shape does not match kind=%r -- points want "
                           "[x, y] and curves [x0, y0, x1, y1]." % (kind,))

            count = len(geo)
            if count:
                log.append("loaded %d of %d %s%s"
                           % (count, len(data), kind,
                              "" if wanted <= 0 else " (seeded sample, source order)"))

    log = "\n".join(log)
# ---------- end read_fixture ----------
read_fixture_2 = Python3Script(sample_n=number_slider_2, seed=number_slider, file_path=panel_2, read_json=toggle)  # -> out; inputs sample_n: Int32, seed: Int32, file_path: String, read_json: Boolean; same code as export_fixture
read_fixture_3 = Python3Script(sample_n=number_slider_2, seed=number_slider, file_path=panel_2, read_json=toggle)  # -> out; inputs sample_n: Int32, seed: Int32, file_path: String, read_json: Boolean; same code as export_fixture
panel_3 = Panel(read_fixture.out)
